# Grasshopper definition Demo1_BadgesToVoxel.gh (Grasshopper 1.0.8)
# plug-ins: RetroVoxel

game = RAGameInfo(Token="<PASTE_TOKEN>", GameID=Slider(1446, range=1..20000))  # -> Status, GameJSON, AchievementJSON
badge = RABadges(AchievementJSON=game.AchievementJSON)  # -> BadgeImagePath, BadgeResourceID, AchievementTitle, PixelColors, Status
grid = PixelGridBuilder(Rows=badge.PixelColors, Pitch="2.0", Thickness="1.0")
vox = VoxelMeshShell(PixelGridJSON=grid, VoxelSize="2.0")
bridge = AchievementAttributeBridge(VoxelMesh=vox, AchievementJSON=game.AchievementJSON)
