# Grasshopper definition Demo2_GridFabrication.gh (Grasshopper 1.0.8)
# plug-ins: RetroVoxel

grid = PixelGridBuilder(
    Rows=["#FF0000, #00FF00, #0000FF", "#0000FF, #FFFFFF, #FF0000", "#00FF00, #FF0000, #FFFFFF", "#FFFFFF, #0000FF, #00FF00"],
    Pitch="2.0",
    Thickness="1.0")
lego = LegoStudPlate(PixelGridJSON=grid, StudSize="8.0")
perler = PerlerBeadGrid(PixelGridJSON=grid, BeadSize="5.0")
led = LEDMatrixMapper(PixelGridJSON=grid, LEDPitch="10.0")  # -> LEDAddressJSON, LEDPosition
