# Grasshopper definition Demo3_SpriteToVoxel.gh (Grasshopper 1.0.8)
# plug-ins: RetroVoxel

panel = Panel("C:\Users\sherft\AppData\Local\Temp\RetroVoxel\badges\321909.png")
load = LocalSpriteLoader(FilePath=panel)  # -> ImagePath, Width, Height, PixelColors
quant = PaletteQuantizer(PixelColors=load.PixelColors, MaxColors="16")  # -> QuantizedColors, Palette, ColorIndices
grid = PixelGridBuilder(Rows=quant.QuantizedColors, Pitch="2.0", Thickness="1.0")
vox = VoxelMeshShell(PixelGridJSON=grid, VoxelSize="2.0")
