# Grasshopper definition Demo4_FilamentInterlock.gh (Grasshopper 1.0.8)
# plug-ins: RetroVoxel

panel = Panel("C:\Users\sherft\AppData\Local\Temp\RetroVoxel\badges\321909.png")
load = LocalSpriteLoader(FilePath=panel)  # -> ImagePath, Width, Height, PixelColors
quant = PaletteQuantizer(PixelColors=load.PixelColors, MaxColors="8")  # -> QuantizedColors, Palette, ColorIndices
panel_2 = Panel("C:\Users\sherft\Downloads\RetroVoxel\RetroVoxel\demos\sample-filament-library.json")
flib = FilamentLibraryLoader(FilePath=panel_2)
match = DeltaEFilamentMatcher(Palette=quant.Palette, FilamentLibraryJSON=flib)
grid = PixelGridBuilder(Rows=quant.QuantizedColors, Pitch="2.0", Thickness="1.0")
vox = VoxelMeshShell(PixelGridJSON=grid, VoxelSize="2.0")
inter = MultiMaterialInterlock(VoxelMesh=vox, FilamentMatchJSON=match)
