# Grasshopper definition Demo5_BoxArtStandoff.gh (Grasshopper 1.0.8)
# plug-ins: RetroVoxel

game = RAGameInfo(Token="<PASTE_TOKEN>", GameID=Slider(1446, range=1..20000))  # -> Status, GameJSON, AchievementJSON
stack = LaserStandoffStack(AspectRatio="0.7", StackCount="4", PanelThickness="3.0")
