# Grasshopper definition Demo6_SpriteSheetSplit.gh (Grasshopper 1.0.8)
# plug-ins: RetroVoxel

panel = Panel("C:\Users\sherft\AppData\Local\Temp\RetroVoxel\badges\321909.png")
load = LocalSpriteLoader(FilePath=panel)  # -> ImagePath, Width, Height, PixelColors
split = SpriteSheetSplitter(ImagePath=load.ImagePath, FrameWidth="16", FrameHeight="16")  # -> FrameImagePath, FrameIndex, PixelColors
panel_2 = Panel(split.FrameImagePath)
panel_3 = Panel(split.FrameIndex)
panel_4 = Panel(split.PixelColors)
